# Grasshopper definition S3_CBDM_Assigment 01_Paul-Suarez-Fuenmayor.gh (Grasshopper 1.0.8)
# plug-ins: Hops

# ----
# 00 / Chair Base
number_slider = Slider(-4.62, range=-10..10)

# ----
# 01 / Seat Height
number_slider_2 = Slider(5.1, range=0..10)

# ----
# 02 / Seat Depth
number_slider_3 = Slider(-5.42, range=-10..10)

# ----
# 03 / Back Position
number_slider_4 = Slider(2.09, range=-10..10)

# ----
# 03 / Back Height
number_slider_5 = Slider(6.76, range=-6.5..10)

_00_chair_base_a = GetNumber(number_slider, AtLeast=1, AtMost=1, Maximum=1.797693135e+308, Minimum=-1.797693135e+308, TreeAccess=False)
_00_chair_base_b = GetNumber(Slider(4.86, range=0..10), AtLeast=1, AtMost=1, Maximum=1.797693135e+308, Minimum=-1.797693135e+308, TreeAccess=False)
_01_seat_height = GetNumber(number_slider_2, AtLeast=1, AtMost=1, Maximum=1.797693135e+308, Minimum=-1.797693135e+308, TreeAccess=False)
_02_seat_depth_a = GetNumber(number_slider_3, AtLeast=1, AtMost=1, Maximum=1.797693135e+308, Minimum=-1.797693135e+308, TreeAccess=False)
_02_seat_depth_b = GetNumber(Slider(1.14, range=-10..10), AtLeast=1, AtMost=1, Maximum=1.797693135e+308, Minimum=-1.797693135e+308, TreeAccess=False)
_02_seat_depth_c = GetNumber(
    Slider(5.48, range=-8.5..5.5),
    AtLeast=1,
    AtMost=1,
    Maximum=1.797693135e+308,
    Minimum=-1.797693135e+308,
    TreeAccess=False)
_03_back_position = GetNumber(number_slider_4, AtLeast=1, AtMost=1, Maximum=1.797693135e+308, Minimum=-1.797693135e+308, TreeAccess=False)
_03_back_height_a = GetNumber(
    number_slider_5,
    AtLeast=1,
    AtMost=1,
    Maximum=1.797693135e+308,
    Minimum=-1.797693135e+308,
    Prompt="03 / Back Height A",
    TreeAccess=False)
_03_back_height_b = GetNumber(Slider(1.61, range=-10..10), AtLeast=1, AtMost=1, Maximum=1.797693135e+308, Minimum=-1.797693135e+308, TreeAccess=False)
cluster = Cluster(
    X=_00_chair_base_a,
    F_2=_00_chair_base_b,
    F=_01_seat_height,
    F_3=_02_seat_depth_a,
    F_4=_02_seat_depth_b,
    F_5=_02_seat_depth_c,
    F_6=_03_back_position,
    F_7=_03_back_height_a,
    F_8=1,
    F_9=_03_back_height_b)
mirror = Mirror(Geometry=cluster, Plane=PlaneYZ(0, 0, 0))  # -> Geometry, Transform
X = UnitX(Factor=Slider(5.89, range=-10..10))
hops = Hops(
    CacheResultsInMemory=True,
    CacheSolveResults=True,
    RemoteSolveVersion=(0, 1, 0),
    ShowInput_Enabled=False,
    ShowInput_Path=False,
    SynchronousSolve=True)
move = Move(Geometry=mirror.Geometry, Motion=X)  # -> reverse(Geometry), Transform
merge = Merge(Data1=cluster, Data2=move.Geometry)
intcrv = Interpolate(Vertices=merge, Degree=Slider(2, range=0..3), Periodic=False, KnotStyle=1)  # -> Curve, Length, Domain
midpt = CurveMiddle(Curve=intcrv.Curve)
pipe = Pipe(Curve=intcrv.Curve, Radius=Slider(0.17, range=0..1), Caps=expr("1", 0))
line = LineSDL(Start=midpt, Direction=Vector(0, 0, 1), Length=1)
ccx = CurveCurve(CurveA=intcrv.Curve, CurveB=line)  # -> Points, ParamsA, ParamsB
shatter = Shatter(Curve=intcrv.Curve, Parameters=ccx.ParamsA)
divide = DivideCurve(Curve=shatter, Count=Slider(69, range=0..100), Kinks=False)  # -> Points, Tangents, Parameters
bang = ExplodeTree(Data=divide.Points)  # -> _0000, reverse(_0001)
ln = Line(StartPoint=bang._0000, EndPoint=bang._0001)
pipe_2 = Pipe(Curve=ln, Radius=Slider(0.05, range=0..1), Caps=expr("1", 0))
merge_2 = Merge(Data1=pipe, Data2=flatten(pipe_2))  # -> flatten(Result)
context_bake = ContextBake(SuaveChair=merge_2)

# ==== cluster Cluster
F = ClusterInput()
F_2 = ClusterInput()
Z = UnitZ(Factor=F)
Z_2 = UnitZ(Factor=F_2)
F_3 = ClusterInput()
F_4 = ClusterInput()
F_5 = ClusterInput()
F_6 = ClusterInput()
F_7 = ClusterInput()
Y = UnitY(Factor=F_3)
Z_3 = UnitZ(Factor=F_4)
Y_2 = UnitY(Factor=F_5)
Y_3 = UnitY(Factor=F_6)
Z_4 = UnitZ(Factor=F_7)
X = ClusterInput()
pt = ConstructPoint(XCoordinate=0, YCoordinate=0, ZCoordinate=0)
pt_2 = ConstructPoint(XCoordinate=X, YCoordinate=0, ZCoordinate=0)
F_8 = ClusterInput()
X_2 = UnitX(Factor=F_8)
move = Move(Geometry=pt, Motion=Z_2)  # -> Geometry, Transform
move_2 = Move(Geometry=pt, Motion=Z)  # -> Geometry, Transform
move_3 = Move(Geometry=move_2.Geometry, Motion=Z_3)  # -> Geometry, Transform
move_4 = Move(Geometry=move_3.Geometry, Motion=Y_2)  # -> Geometry, Transform
move_5 = Move(Geometry=move_4.Geometry, Motion=Y_3)  # -> Geometry, Transform
move_6 = Move(Geometry=move.Geometry, Motion=Y)  # -> Geometry, Transform
move_7 = Move(Geometry=move_5.Geometry, Motion=Z_4)  # -> Geometry, Transform
F_9 = ClusterInput()
move_8 = Move(Geometry=move_7.Geometry, Motion=X_2)  # -> Geometry, Transform
Z_5 = UnitZ(Factor=F_9)
move_9 = Move(Geometry=move_8.Geometry, Motion=Z_5)  # -> Geometry, Transform
merge = Merge(
    Data1=pt_2,
    Data2=move_6.Geometry,
    Data3=move_2.Geometry,
    Data4=move_4.Geometry,
    Data5=move_7.Geometry,
    Data6=move_9.Geometry)
R = ClusterOutput(merge)
